% Simulink data dictionary RL_data.sldd

initialAngle_deg = Simulink.Parameter(0, Unit="deg")
reward_Cact_d = 1
reward_Calive = 5
reward_Cdist = 4
reward_Ck = 5
reward_Crate = 2
reward_Csteer_d = 5
reward_Cy = 1
reward_Cyaw = 5
reward_Rfail = 10
reward_Rsuccess = 100